# Grasshopper definition Coordinates.gh (Grasshopper 1.0.7)
# Copyright: Arup
# plug-ins: TT Toolbox

crv = Curve(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)
crv_2 = Curve(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)
crv_3 = Curve(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)
pt = Point([Point(0, -107, -1), Point(0, -192.4568771, -1), Point(0, -234, -1), Point(0, -234, 31.27063692), Point(0, -234, 82), Point(0, -168, 20), Point(0, -107, 82)])
crv_4 = Curve(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)
crv_5 = Curve(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)
crv_6 = Curve(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)
curvetopts = CurveToPts(C=crv_4)
curvetopts_2 = CurveToPts(C=crv)
curvetopts_3 = CurveToPts(C=crv_2)
curvetopts_4 = CurveToPts(C=crv_3)
curvetopts_5 = CurveToPts(C=crv_6)
curvetopts_6 = CurveToPts(C=crv_5)
panel = Panel(pt)
tbi = TreeBranchIndex(BranchIndex="0")
pt_2 = Point([curvetopts, curvetopts_4])
subtraction = Subtraction(A=Slider(11, range=1..14), B="1")
panel_2 = Panel(subtraction)
item = ListItem(List=pt_2, Index=subtraction, Wrap=True)
tester = CSharpScript(
    Points=curvetopts,
    Opening1Pts=curvetopts_4,
    Reference=["C:\Nicolaas\Repo\SpeckleStructural\Speckle2dMesher\bin\Debug\Speckle2dMesher.dll", "C:\Nicolaas\Repo\SpeckleStructural\Speckle2dMesher\bin\Debug\MathNet.Spatial.dll"])  # -> out, InternalLines; inputs Points: list of Point3d, Opening1Pts: list of Point3d, Opening2Pts: list of Point3d
# ---------- tester: C# usings ----------
using Speckle2dMesher;
# ---------- tester: C# ----------
    Print("Test");
    var ma = new MeshArea();
  
    
    var openingPointsList = new List<double[]>();
    if (Opening1Pts != null && Opening1Pts.Count > 0)
    {
      openingPointsList.Add(PointsToCoords(Opening1Pts));
    }
    if (Opening2Pts != null && Opening2Pts.Count > 0)
    {
      openingPointsList.Add(PointsToCoords(Opening2Pts));
    }

    ma.Init(PointsToCoords(Points), openingPointsList);
    ma.GenerateInternals();

    var internalGlobalCoords = ma.GetInternalGlobalCoords();

    Print("Check");
    var lines = new List<Rhino.Geometry.Line>();
    foreach (var coords in internalGlobalCoords)
    {
      var pt1 = new Rhino.Geometry.Point3d(coords[0], coords[1], coords[2]);
      InternalLines = pt1;
      return;
      var pt2 = new Rhino.Geometry.Point3d(coords[3], coords[4], coords[5]);
      lines.Add(new Rhino.Geometry.Line(pt1, pt2));
    }

    //InternalLines = lines;
    //var faces = ma.Faces();
# ---------- tester: C# additional code ----------
  private double[] PointsToCoords(List<Point3d> Points)
  {
    var vs = new List<double>();
    foreach (Point3d p in Points)
    {
      vs.Add(p.X);
      vs.Add(p.Y);
      vs.Add(p.Z);
    }
    return vs.ToArray();
  }
# ---------- end tester ----------
pt_3 = Point(item)
c_script = CSharpScript(
    Points=curvetopts,
    Reference=["C:\Nicolaas\Repo\SpeckleStructural\Speckle2dMesher\bin\Debug\MathNet.Spatial.dll", "C:\Nicolaas\Repo\SpeckleStructural\Speckle2dMesher\bin\Debug\MathNet.Numerics.dll", "C:\Nicolaas\Repo\SpeckleStructural\Speckle2dMesher\bin\Debug\Speckle2dMesher.dll"])  # -> out, A; inputs Points: list of Point3d
# ---------- c_script: C# ----------
    Tester();
    Print("Test");
# ---------- c_script: C# additional code ----------
  public void Tester()
  {
    var ma = new MeshArea();
    Print("Test");
  }
# ---------- end c_script ----------
line = Line(tester.InternalLines)
panel_3 = Panel(c_script.out)

# ==== cluster CurveToPts
C = ClusterInput()
explode = Explode(Curve=C, Recursive=True)  # -> Segments, Vertices
cullduppoints = RemoveDuplicatePoints(InputPoints=explode.Vertices, Tolerance=0.001)  # -> OutputPoints, FirstPointIndexes
clean = CleanTree(RemoveNulls=True, RemoveInvalid=True, RemoveEmpty=False, Tree=cullduppoints.OutputPoints)
pt = Point(clean)
pt_2 = ClusterOutput(pt)
